# Grasshopper definition 00_Simple beam [Feb-05 '22, 1209].gh (Grasshopper 1.0.7)
# plug-ins: Bifocals, Karamba3D

# Geometric Steps: - Draw two points
# - Draw a line
# Mechanical Steps: - Line to Beam
# - Boundary Conditions (supports)
# - Loads
# - Assemble Model
# - Run Analyses
# - Read Results
pt = ConstructPoint(XCoordinate=0, YCoordinate=0, ZCoordinate=0)
pt_2 = ConstructPoint(XCoordinate=Slider(21.54, range=1..50), YCoordinate=0, ZCoordinate=0)
ln = Line(StartPoint=pt, EndPoint=pt_2)

crv = Curve(ln)
matselect = MaterialSelectionKaramba3D(menu=[dropdown(5), dropdown(1)])
cross_section = CrossSectionKaramba3D(
    FamilyNameOfCrossSection="DefaultCroSec",
    Material=matselect,
    Height_cm="20",
    UpperFlangeWidth_cm="5",
    LowerFlangeWidth_cm="5",
    mode="Trapezoid")

start_point = Point(pt)
end_point = Point(pt_2)
neg = Negative(Value=Slider(1, range=1..20))
vec = VectorXYZ(XComponent=0, YComponent=0, ZComponent=neg)  # -> Vector, Length
data = Data("bridge")
supp = SupportKaramba3D(PosInd=start_point, menu=[buttons(on, on, on, on, on, on)])
supp_2 = SupportKaramba3D(PosInd=end_point, menu=[buttons(off, on, on, on, on, on)])

# ---- group: Loads (Karamba3D)
loads = LoadsKaramba3D(Vector=Vector(0, 0, -1), LCase="0", mode="Gravity")

# ----
beam_loads = BeamLoadsKaramba3D(BeamIdentifier=data, LoadCase="1", ForceVector=vec.Vector, TStart=0, TEnd=1, mode="Block", menu=[buttons(off, on, off)])
panel_2 = Panel("1 kN = 100 kg")
panel_3 = Panel("F = m * a")

# ---- group: Line to Beam (Karamba3D)
linetobeam = LineToBeamKaramba3D(
    Line=crv,
    Identifier="bridge",
    CrossSection=cross_section,
    New=True,
    Remove=True,
    LimitDistance_m=0.005,
    Bending=True,
    SetBucklingLength=True,
    ToPolylineMaxAngle=0.03,
    ToPolylineTolerance=0.01,
    ToPolylineMinEdgeLength=0.25)  # -> Element, Points, Info

# ----
element = ElementKaramba3D(flatten(linetobeam.Element))
load = LoadKaramba3D(flatten([loads, beam_loads]))
support = SupportKaramba3D(flatten([supp, supp_2]))

# ---- group: Assemble Model (Karamba3D)
assemble = AssembleModelKaramba3D(Elem=element, Support=support, Load=load, LimitDistance_m=0.005)  # -> Model, Info, Mass_kg, CenterOfGravity, LoadCaseNames

# ---- group: Analyze (Karamba3D)
analyze = AnalyzeKaramba3D(Model=assemble.Model)  # -> CalculatedModel, MaximumDisplacement_cm, ResultingForceOfGravity_kN, ElasticEnergyChange_kNm

# ----
panel_4 = Panel(analyze.MaximumDisplacement_cm)
clr = ColorsAlpaca4d(gradIndex=Slider(11, range=0..12))  # -> colors; inputs gradIndex: Int32
#   port colors: A series of colors to be plugged into the "Ladybug_Legend Parameters" component.
# ---------- clr: Python ----------
"""
Preset of gradient colors perfect for Data Visualisation
    Inputs:
        gradIndex: An index refering to one of the following possible gradients:
            0 - Orignal Ladybug
            1 - Nuanced Ladybug
            2 - Multi-colored Ladybug
            3 - Ecotect
            4 - Thermal Comfort Percentage
            5 - Thermal Comfort Colors
            6 - Shade Benefit/Harm
            7 - Shade Harm
            8 - Shade Benefit
            9 - CFD Colors 1
            10 - Radiation Benefit
            11 - Gsa10 Colour
            12 - Gsa9 Colour
    Returns:
        customColors: A series of colors.
"""

ghenv.Component.Name = "Colors (Alpaca4d)"
ghenv.Component.NickName = 'CLR'
ghenv.Component.Message = 'Colors (Alpaca4d)'

import scriptcontext as sc
import Grasshopper.Kernel as gh
import System

gradientLibrary = {
        0: [System.Drawing.Color.FromArgb(75, 107, 169), System.Drawing.Color.FromArgb(115, 147, 202), System.Drawing.Color.FromArgb(170, 200, 247), System.Drawing.Color.FromArgb(193, 213, 208), System.Drawing.Color.FromArgb(245, 239, 103), System.Drawing.Color.FromArgb(252, 230, 74), System.Drawing.Color.FromArgb(239, 156, 21), System.Drawing.Color.FromArgb(234, 123, 0), System.Drawing.Color.FromArgb(234, 74, 0), System.Drawing.Color.FromArgb(234, 38, 0)],
        1: [System.Drawing.Color.FromArgb(49,54,149), System.Drawing.Color.FromArgb(69,117,180), System.Drawing.Color.FromArgb(116,173,209), System.Drawing.Color.FromArgb(171,217,233), System.Drawing.Color.FromArgb(224,243,248), System.Drawing.Color.FromArgb(255,255,191), System.Drawing.Color.FromArgb(254,224,144), System.Drawing.Color.FromArgb(253,174,97), System.Drawing.Color.FromArgb(244,109,67), System.Drawing.Color.FromArgb(215,48,39), System.Drawing.Color.FromArgb(165,0,38)],
        2: [System.Drawing.Color.FromArgb(4,25,145), System.Drawing.Color.FromArgb(7,48,224), System.Drawing.Color.FromArgb(7,88,255), System.Drawing.Color.FromArgb(1,232,255), System.Drawing.Color.FromArgb(97,246,156), System.Drawing.Color.FromArgb(166,249,86), System.Drawing.Color.FromArgb(254,244,1), System.Drawing.Color.FromArgb(255,121,0), System.Drawing.Color.FromArgb(239,39,0), System.Drawing.Color.FromArgb(138,17,0)],
        3: [System.Drawing.Color.FromArgb(0,0,255), System.Drawing.Color.FromArgb(53,0,202), System.Drawing.Color.FromArgb(107,0,148), System.Drawing.Color.FromArgb(160,0,95), System.Drawing.Color.FromArgb(214,0,41), System.Drawing.Color.FromArgb(255,12,0), System.Drawing.Color.FromArgb(255,66,0), System.Drawing.Color.FromArgb(255,119,0), System.Drawing.Color.FromArgb(255,173,0), System.Drawing.Color.FromArgb(255,226,0), System.Drawing.Color.FromArgb(255,255,0)],
        4: [System.Drawing.Color.FromArgb(0,0,0), System.Drawing.Color.FromArgb(110,0,153), System.Drawing.Color.FromArgb(255,0,0), System.Drawing.Color.FromArgb(255,255,102), System.Drawing.Color.FromArgb(255,255,255)],
        5: [System.Drawing.Color.FromArgb(0,136,255), System.Drawing.Color.FromArgb(200,225,255), System.Drawing.Color.FromArgb(255,255,255), System.Drawing.Color.FromArgb(255,230,230), System.Drawing.Color.FromArgb(255,0,0)],
        6: [System.Drawing.Color.FromArgb(5,48,97), System.Drawing.Color.FromArgb(33,102,172), System.Drawing.Color.FromArgb(67,147,195), System.Drawing.Color.FromArgb(146,197,222), System.Drawing.Color.FromArgb(209,229,240), System.Drawing.Color.FromArgb(255,255,255), System.Drawing.Color.FromArgb(253,219,199), System.Drawing.Color.FromArgb(244,165,130), System.Drawing.Color.FromArgb(214,96,77), System.Drawing.Color.FromArgb(178,24,43), System.Drawing.Color.FromArgb(103,0,31)],
        7: [System.Drawing.Color.FromArgb(255,255,255), System.Drawing.Color.FromArgb(253,219,199), System.Drawing.Color.FromArgb(244,165,130), System.Drawing.Color.FromArgb(214,96,77), System.Drawing.Color.FromArgb(178,24,43), System.Drawing.Color.FromArgb(103,0,31)],
        8: [System.Drawing.Color.FromArgb(255,255,255), System.Drawing.Color.FromArgb(209,229,240), System.Drawing.Color.FromArgb(146,197,222), System.Drawing.Color.FromArgb(67,147,195), System.Drawing.Color.FromArgb(33,102,172), System.Drawing.Color.FromArgb(5,48,97)],
        9: [System.Drawing.Color.FromArgb(0,16,120), System.Drawing.Color.FromArgb(38,70,160), System.Drawing.Color.FromArgb(5,180,222), System.Drawing.Color.FromArgb(16,180,109), System.Drawing.Color.FromArgb(59,183,35), System.Drawing.Color.FromArgb(143,209,19), System.Drawing.Color.FromArgb(228,215,29), System.Drawing.Color.FromArgb(246,147,17), System.Drawing.Color.FromArgb(243,74,0), System.Drawing.Color.FromArgb(255,0,0)],
        10: [System.Drawing.Color.FromArgb(0,191,48), System.Drawing.Color.FromArgb(255,238,184), System.Drawing.Color.FromArgb(255,0,0)],
        11: [System.Drawing.Color.FromArgb(204,0,71), System.Drawing.Color.FromArgb(255,182,71), System.Drawing.Color.FromArgb(206,255,115), System.Drawing.Color.FromArgb(26,180, 214),System.Drawing.Color.FromArgb(0,0,207)],
        12: [System.Drawing.Color.FromArgb(255, 51, 51), System.Drawing.Color.FromArgb(255, 170, 51), System.Drawing.Color.FromArgb(255, 255, 51), System.Drawing.Color.FromArgb(170, 255, 125), System.Drawing.Color.FromArgb(51, 255, 231), System.Drawing.Color.FromArgb(51, 170, 255), System.Drawing.Color.FromArgb(51,51, 255)]}
colors = gradientLibrary[gradIndex]
# ---------- end clr ----------
merge = Merge(
    Data1=ColourSwatch(SwatchColor=RGB(0, 255, 255)),
    Data2=ColourSwatch(SwatchColor=RGB(255, 0, 0)),
    Data3=ColourSwatch(SwatchColor=RGB(255, 255, 255)),
    Data4=ColourSwatch(SwatchColor=RGB(4, 0, 255)))

# ---- group: Model View (Karamba3D)
modelview = ModelViewKaramba3D(Model=analyze.CalculatedModel, ResultFactors=1, ResultCase=-1, Colors=clr)  # -> Model, DeformedMesh, DeformedAxes, DeformedModel

# ----
panel_5 = Panel("""Local Axis
RGB = XYZ""")

# ---- group: Beam View (Karamba3D)
beamview = BeamViewKaramba3D(Model=modelview.Model)  # -> Model, MeshesOfRenderedBeams, DeformedBeamAxes, LegendColors, LegendTags

# ----
utilization = UtilizationOfElementsKaramba3D(
    AnalyzedModel=modelview.Model,
    NumberOfSamplePoints=3,
    ElasticDesign=True,
    GammaM0=1,
    GammaM1=1.1,
    SwayFrame=True,
    WithDetails=False,
    mode="Beams")  # -> AnalyzedModel, Utilization, SigMax_kN_cm2, SigMin_kN_cm2, TauMax_kN_cm2, UtilN, UtilVy, UtilVz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
legend = Legend(Colour=beamview.LegendColors, Tags=beamview.LegendTags, LegendType=1)
if_greater_than_1_is_failing = Panel(utilization.Utilization)
