# Grasshopper definition 02_Spatial Beam Structure.gh (Grasshopper 1.0.7)
# plug-ins: Bifocals, Karamba3D

box = DomainBox(Base=PlaneXY(0, 0, 0), X=Slider(11, range=1..20), Y=Slider(3, range=1..20), Z=Slider(3, range=1..20))
# Geometric Steps: - Draw two points
# - Draw a line
# Mechanical Steps: - Line to Beam
# - Boundary Conditions (supports)
# - Loads
# - Assemble Model
# - Run Analyses
# - Read Results
pop3d = Populate3D(Region=box, Count=100, Seed=1)
voronoi³ = Voronoi3D(Points=pop3d, Box=box)  # -> Cells, Boundary
edges = BrepEdges(Brep=voronoi³.Cells)  # -> Naked, flatten(Interior), NonManifold
rdlines = RemoveDuplicateLinesKaramba3D(Line=edges.Interior, LimitDistance=0.005)  # -> OutLine, Info, Indexes
debrep = DeconstructBrep(Brep=box)  # -> Faces, Edges, Vertices
explode = Explode(Curve=rdlines.OutLine, Recursive=True)  # -> Segments, flatten(Vertices)
rdpoints = RemoveDuplicatePointsKaramba3D(Point=explode.Vertices, LimitDistance=0.005)  # -> OutPoint, Info, Indexes
item = ListItem(List=debrep.Faces, Index=Slider(1, range=0..5), Wrap=True)
pull = PullPoint(Point=rdpoints.OutPoint, Geometry=item, ClosestOnly=True)  # -> ClosestPoint, Distance
smaller = SmallerThan(FirstNumber=pull.Distance, SecondNumber="0.1")  # -> SmallerThan, OrEqualTo
cull = CullPattern(List=rdpoints.OutPoint, CullPattern=smaller.SmallerThan)

# ---- group: create family
matselect = MaterialSelectionKaramba3D(menu=[dropdown(5), dropdown(1)])
dedomain = DeconstructDomain(Domain="20 to 100")  # -> Start, End
subtraction = Subtraction(A=dedomain.End, B=dedomain.Start)
division = Division(A=subtraction, B="10")
range = Range(Domain="20 to 100", Steps=division)
cross_section = CrossSectionKaramba3D(
    FamilyNameOfCrossSection="DefaultCroSec",
    Material=matselect,
    Height_cm=range,
    UpperFlangeWidth_cm="5",
    LowerFlangeWidth_cm="5",
    mode="Trapezoid")

# ----
dedomain_2 = DeconstructDomain(Domain="2 to 20")  # -> Start, End
subtraction_2 = Subtraction(A=dedomain_2.End, B=dedomain_2.Start)
division_2 = Division(A=subtraction_2, B="2")
range_2 = Range(Domain="2 to 20", Steps=division_2)
number_slider = Slider(1, range=1..20)
cross_section_2 = CrossSectionKaramba3D(
    FamilyNameOfCrossSection="DefaultCroSec",
    Material=matselect,
    Diameter_cm=range_2,
    WallThickness_cm="1",
    mode="Circular Hollow")
support_points = Point(cull)
neg = Negative(Value=Slider(0.18, range=0.01..1))
item_2 = ListItem(List=cross_section_2, Index=0, Wrap=True)

crv = Curve(rdlines.OutLine)
crosec = CrossSectionKaramba3D(item_2)

vec = VectorXYZ(XComponent=0, YComponent=0, ZComponent=neg)  # -> Vector, Length
data = Data("Cell Beam")
supp = SupportKaramba3D(PosInd=support_points, menu=[buttons(on, on, on, on, on, on)])

# ---- group: Loads (Karamba3D)
loads = LoadsKaramba3D(Vector=Vector(0, 0, -1), LCase="0", mode="Gravity")

# ----
beam_loads = BeamLoadsKaramba3D(BeamIdentifier=data, LoadCase="1", ForceVector=vec.Vector, TStart=0, TEnd=1, mode="Block", menu=[buttons(off, on, off)])
panel_2 = Panel("1 kN = 100 kg")
panel_3 = Panel("F = m * a")

# ---- group: Line to Beam (Karamba3D)
linetobeam = LineToBeamKaramba3D(
    Line=crv,
    Identifier="Cell Beam",
    CrossSection=crosec,
    New=True,
    Remove=True,
    LimitDistance_m=0.005,
    Bending=True,
    SetBucklingLength=True,
    ToPolylineMaxAngle=0.03,
    ToPolylineTolerance=0.01,
    ToPolylineMinEdgeLength=0.25)  # -> Element, Points, Info

# ----
element = ElementKaramba3D(flatten(linetobeam.Element))
support = SupportKaramba3D(flatten(supp))
load = LoadKaramba3D(flatten([loads, beam_loads]))

# ---- group: Assemble Model (Karamba3D)
assemble = AssembleModelKaramba3D(Elem=element, Support=support, Load=load, LimitDistance_m=0.005)  # -> Model, Info, Mass_kg, CenterOfGravity, LoadCaseNames

# ----
crosec_2 = CrossSectionKaramba3D(cross_section_2)

# ---- group: Optimize Cross Section (Karamba3D)
opticrosec = OptimizeCrossSectionKaramba3D(
    Model=assemble.Model,
    CrossSections=crosec_2,
    MaximumUtilization=1,
    UltimateLimitStateIterations=5,
    DisplacementIterations=5,
    NumberOfSamplePoints=3,
    ElasticDesign=True,
    GammaM0=1,
    GammaM1=1.1,
    SwayFrame=True)  # -> ModelWithOptimizedCrossSections, Info, Mass_kg, MaximumDisplacement_cm, ElasticEnergyChange_kNm

# ----
panel_4 = Panel(opticrosec.MaximumDisplacement_cm)
clr = ColorsAlpaca4d(gradIndex=Slider(11, range=0..12))  # -> colors; inputs gradIndex: Int32
#   port colors: A series of colors to be plugged into the "Ladybug_Legend Parameters" component.
# ---------- clr: Python ----------
"""
Preset of gradient colors perfect for Data Visualisation
    Inputs:
        gradIndex: An index refering to one of the following possible gradients:
            0 - Orignal Ladybug
            1 - Nuanced Ladybug
            2 - Multi-colored Ladybug
            3 - Ecotect
            4 - Thermal Comfort Percentage
            5 - Thermal Comfort Colors
            6 - Shade Benefit/Harm
            7 - Shade Harm
            8 - Shade Benefit
            9 - CFD Colors 1
            10 - Radiation Benefit
            11 - Gsa10 Colour
            12 - Gsa9 Colour
    Returns:
        customColors: A series of colors.
"""

ghenv.Component.Name = "Colors (Alpaca4d)"
ghenv.Component.NickName = 'CLR'
ghenv.Component.Message = 'Colors (Alpaca4d)'

import scriptcontext as sc
import Grasshopper.Kernel as gh
import System

gradientLibrary = {
        0: [System.Drawing.Color.FromArgb(75, 107, 169), System.Drawing.Color.FromArgb(115, 147, 202), System.Drawing.Color.FromArgb(170, 200, 247), System.Drawing.Color.FromArgb(193, 213, 208), System.Drawing.Color.FromArgb(245, 239, 103), System.Drawing.Color.FromArgb(252, 230, 74), System.Drawing.Color.FromArgb(239, 156, 21), System.Drawing.Color.FromArgb(234, 123, 0), System.Drawing.Color.FromArgb(234, 74, 0), System.Drawing.Color.FromArgb(234, 38, 0)],
        1: [System.Drawing.Color.FromArgb(49,54,149), System.Drawing.Color.FromArgb(69,117,180), System.Drawing.Color.FromArgb(116,173,209), System.Drawing.Color.FromArgb(171,217,233), System.Drawing.Color.FromArgb(224,243,248), System.Drawing.Color.FromArgb(255,255,191), System.Drawing.Color.FromArgb(254,224,144), System.Drawing.Color.FromArgb(253,174,97), System.Drawing.Color.FromArgb(244,109,67), System.Drawing.Color.FromArgb(215,48,39), System.Drawing.Color.FromArgb(165,0,38)],
        2: [System.Drawing.Color.FromArgb(4,25,145), System.Drawing.Color.FromArgb(7,48,224), System.Drawing.Color.FromArgb(7,88,255), System.Drawing.Color.FromArgb(1,232,255), System.Drawing.Color.FromArgb(97,246,156), System.Drawing.Color.FromArgb(166,249,86), System.Drawing.Color.FromArgb(254,244,1), System.Drawing.Color.FromArgb(255,121,0), System.Drawing.Color.FromArgb(239,39,0), System.Drawing.Color.FromArgb(138,17,0)],
        3: [System.Drawing.Color.FromArgb(0,0,255), System.Drawing.Color.FromArgb(53,0,202), System.Drawing.Color.FromArgb(107,0,148), System.Drawing.Color.FromArgb(160,0,95), System.Drawing.Color.FromArgb(214,0,41), System.Drawing.Color.FromArgb(255,12,0), System.Drawing.Color.FromArgb(255,66,0), System.Drawing.Color.FromArgb(255,119,0), System.Drawing.Color.FromArgb(255,173,0), System.Drawing.Color.FromArgb(255,226,0), System.Drawing.Color.FromArgb(255,255,0)],
        4: [System.Drawing.Color.FromArgb(0,0,0), System.Drawing.Color.FromArgb(110,0,153), System.Drawing.Color.FromArgb(255,0,0), System.Drawing.Color.FromArgb(255,255,102), System.Drawing.Color.FromArgb(255,255,255)],
        5: [System.Drawing.Color.FromArgb(0,136,255), System.Drawing.Color.FromArgb(200,225,255), System.Drawing.Color.FromArgb(255,255,255), System.Drawing.Color.FromArgb(255,230,230), System.Drawing.Color.FromArgb(255,0,0)],
        6: [System.Drawing.Color.FromArgb(5,48,97), System.Drawing.Color.FromArgb(33,102,172), System.Drawing.Color.FromArgb(67,147,195), System.Drawing.Color.FromArgb(146,197,222), System.Drawing.Color.FromArgb(209,229,240), System.Drawing.Color.FromArgb(255,255,255), System.Drawing.Color.FromArgb(253,219,199), System.Drawing.Color.FromArgb(244,165,130), System.Drawing.Color.FromArgb(214,96,77), System.Drawing.Color.FromArgb(178,24,43), System.Drawing.Color.FromArgb(103,0,31)],
        7: [System.Drawing.Color.FromArgb(255,255,255), System.Drawing.Color.FromArgb(253,219,199), System.Drawing.Color.FromArgb(244,165,130), System.Drawing.Color.FromArgb(214,96,77), System.Drawing.Color.FromArgb(178,24,43), System.Drawing.Color.FromArgb(103,0,31)],
        8: [System.Drawing.Color.FromArgb(255,255,255), System.Drawing.Color.FromArgb(209,229,240), System.Drawing.Color.FromArgb(146,197,222), System.Drawing.Color.FromArgb(67,147,195), System.Drawing.Color.FromArgb(33,102,172), System.Drawing.Color.FromArgb(5,48,97)],
        9: [System.Drawing.Color.FromArgb(0,16,120), System.Drawing.Color.FromArgb(38,70,160), System.Drawing.Color.FromArgb(5,180,222), System.Drawing.Color.FromArgb(16,180,109), System.Drawing.Color.FromArgb(59,183,35), System.Drawing.Color.FromArgb(143,209,19), System.Drawing.Color.FromArgb(228,215,29), System.Drawing.Color.FromArgb(246,147,17), System.Drawing.Color.FromArgb(243,74,0), System.Drawing.Color.FromArgb(255,0,0)],
        10: [System.Drawing.Color.FromArgb(0,191,48), System.Drawing.Color.FromArgb(255,238,184), System.Drawing.Color.FromArgb(255,0,0)],
        11: [System.Drawing.Color.FromArgb(204,0,71), System.Drawing.Color.FromArgb(255,182,71), System.Drawing.Color.FromArgb(206,255,115), System.Drawing.Color.FromArgb(26,180, 214),System.Drawing.Color.FromArgb(0,0,207)],
        12: [System.Drawing.Color.FromArgb(255, 51, 51), System.Drawing.Color.FromArgb(255, 170, 51), System.Drawing.Color.FromArgb(255, 255, 51), System.Drawing.Color.FromArgb(170, 255, 125), System.Drawing.Color.FromArgb(51, 255, 231), System.Drawing.Color.FromArgb(51, 170, 255), System.Drawing.Color.FromArgb(51,51, 255)]}
colors = gradientLibrary[gradIndex]
# ---------- end clr ----------
merge = Merge(
    Data1=ColourSwatch(SwatchColor=RGB(0, 255, 255)),
    Data2=ColourSwatch(SwatchColor=RGB(255, 0, 0)),
    Data3=ColourSwatch(SwatchColor=RGB(255, 255, 255)),
    Data4=ColourSwatch(SwatchColor=RGB(4, 0, 255)))

# ---- group: Model View (Karamba3D)
modelview = ModelViewKaramba3D(Model=opticrosec.ModelWithOptimizedCrossSections, ResultFactors=1, ResultCase=-1, Colors=clr)  # -> Model, DeformedMesh, DeformedAxes, DeformedModel

# ----
panel_5 = Panel("""Local Axis
RGB = XYZ""")

# ---- group: Beam View (Karamba3D)
beamview = BeamViewKaramba3D(Model=modelview.Model)  # -> Model, MeshesOfRenderedBeams, DeformedBeamAxes, LegendColors, LegendTags

# ----
utilization = UtilizationOfElementsKaramba3D(
    AnalyzedModel=modelview.Model,
    NumberOfSamplePoints=3,
    ElasticDesign=True,
    GammaM0=1,
    GammaM1=1.1,
    SwayFrame=True,
    WithDetails=False,
    mode="Beams")  # -> AnalyzedModel, Utilization, SigMax_kN_cm2, SigMin_kN_cm2, TauMax_kN_cm2, UtilN, UtilVy, UtilVz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
legend = Legend(Colour=beamview.LegendColors, Tags=beamview.LegendTags, LegendType=1)
bnd = Bounds(Numbers=utilization.Utilization)
panel_6 = Panel(bnd)

data_2 = Data(utilization.Utilization)
data_3 = Data(clr)
lgnd = LegendAlpaca4d(Title="Utilisation", Data=data_2, Colors=data_3, Pos=Slider(2, range=0..2))  # inputs Data: list, Colors: list, Pos: Int32
# ---------- lgnd: Python ----------
"""Visualise a legend on screen
    Inputs:
        Title:
        Data:
        Colors:
        Pos:
        Scale:
    Output:
        """





from ghpythonlib.componentbase import executingcomponent as component
import Rhino as rc
import System


ghenv.Component.Name = "Legend (Alpaca4d)"
ghenv.Component.NickName = 'LGND'
ghenv.Component.Message = 'Legend (Alpaca4d)'

class MyComponent(component):

    def RunScript(self,Title,Data,Colors,Pos,Scale):
        # Assign input variables
        
        self.title = Title
        self.col = Colors
        self.scale = Scale
        self.data = Data
        
        
        self.pos = 2 if Pos is None else Pos
        
        RhinoDocument = rc.RhinoDoc.ActiveDoc
        self.active_view = RhinoDocument.Views.ActiveView

        self.black = System.Drawing.Color.Black
        
        if not self.scale:
            self.scale = 1.5
        
        if self.data:
            self.min_number = float(min(self.data))
            self.max_number = float(max(self.data))
        else:
            self.min_number = -1.0
            self.max_number = 1.0
        
        if not self.col:
            self.col = [System.Drawing.Color.FromArgb(255, 51, 51), System.Drawing.Color.FromArgb(255, 170, 51), System.Drawing.Color.FromArgb(255, 255, 51), System.Drawing.Color.FromArgb(170, 255, 125), System.Drawing.Color.FromArgb(51, 255, 231), System.Drawing.Color.FromArgb(51, 170, 255), System.Drawing.Color.FromArgb(51,51, 255)]
        
        
        self.diff = self.max_number - self.min_number
        
        self.range = len(self.col) + 1



    def DrawViewportWires(self,arg):
        
        
        width = self.active_view.Size.Width
        height = self.active_view.Size.Height
        
        anchor_y = height * 0.075
        
        
        if self.pos == 0:
            anchor_x = width * 0.025
        elif self.pos == 1:
            anchor_x = width * (1- 0.125)
        elif self.pos == 2:
            anchor_x = width * 0.5
            anchor_y = height * (1 - 0.125)
        
        
        
        
        
        rect_x = 20 * self.scale
        rect_y = 20 * self.scale
        
        txt_height = rect_y * 0.6
        title_height = rect_y * 0.9
        
        
        
        # Vertical Gradient
        if self.pos == 0 or self.pos == 1:
        
        # Title
            pt = rc.Geometry.Point2d(anchor_x, anchor_y - 3/(1.6) * txt_height)
            arg.Display.Draw2dText(self.title ,self.black,pt,False,title_height,"Arial")
        
            for i,col in enumerate(self.col):
                
                
                # Rectangle is drawn in front of mesh
                rec2d = System.Drawing.Rectangle(anchor_x,anchor_y + i * rect_y, rect_x,rect_y)
                arg.Display.Draw2dRectangle(rec2d,self.black,3,col)


                value = self.diff * i/self.range + self.min_number
                value = "{:.1f}".format(value)
                
                # Text is drawn in front of mesh
                pt = rc.Geometry.Point2d(anchor_x + 1.5 * rect_x, anchor_y - 1/(1.6*2) * txt_height + i * rect_y)
                
                arg.Display.Draw2dText(value,self.black,pt,False,txt_height,"Arial")
            
            i += 1
            pt = rc.Geometry.Point2d(anchor_x + 1.5 * rect_x, anchor_y - 1/(1.6*2) * txt_height + i * rect_y)
            value = "{:.1f}".format(self.max_number)
            arg.Display.Draw2dText(value,self.black,pt,False,txt_height,"Arial")

        # Horizontal Gradient
        if self.pos == 2:
        
        # Title
            pt = rc.Geometry.Point2d(anchor_x, anchor_y - 3/(1.6) * txt_height)
            arg.Display.Draw2dText(self.title,self.black,pt,False,title_height,"Arial")
            
            
            for i,col in enumerate(self.col):
                
                # Rectangle is drawn in front of mesh
                rec2d = System.Drawing.Rectangle(anchor_x + i * rect_x, anchor_y, rect_x,rect_y)
                arg.Display.Draw2dRectangle(rec2d,self.black,3,col)


                value = self.diff * i/self.range + self.min_number
                value = "{:.1f}".format(value)
                
                # Text is drawn in front of mesh
                #pt = rc.Geometry.Point2d(anchor_x + 1.5 * rect_x, anchor_y - 1/(1.6*2) * txt_height + i * rect_y)
                pt = rc.Geometry.Point2d(anchor_x - 1/(1.6) * txt_height + i * rect_x, anchor_y + 3/(1.2) * txt_height)
                arg.Display.Draw2dText(value,self.black,pt,False,txt_height/1.4,"Arial")
            
            i += 1
            pt = rc.Geometry.Point2d(anchor_x - 1/(1.2) * txt_height + i * rect_x, anchor_y + 3/(1.2) * txt_height)
            value = "{:.1f}".format(self.max_number)
            arg.Display.Draw2dText(value,self.black,pt,False,txt_height/1.4,"Arial")
# ---------- end lgnd ----------
