# Grasshopper definition 04_Shell Structure.gh (Grasshopper 1.0.7)
# plug-ins: Karamba3D, Kangaroo2 Components, Weaverbird, Human

planesrf = PlaneSurface(Plane=PlaneXY(0, 0, 0), XSize=Slider(10, range=5..10), YSize="20")
sdivide = DivideSurface(Surface=planesrf, UCount="6", VCount="20")  # -> simplify(flatten(Points)), Normals, Parameters
edges = BrepEdges(Brep=planesrf)  # -> Naked, Interior, NonManifold
join = JoinCurves(Curves=edges.Naked, Preserve=False)
pull = PullPoint(Point=sdivide.Points, Geometry=join, ClosestOnly=True)  # -> ClosestPoint, Distance
graft = GraftTree(Tree=sdivide.Points, IncludeEmptyLists=True, IncludeNullItems=True)
graft_2 = GraftTree(Tree=pull.Distance, IncludeEmptyLists=True, IncludeNullItems=True)
smaller = SmallerThan(FirstNumber=graft_2, SecondNumber="0.001")  # -> SmallerThan, OrEqualTo
dispatch = Dispatch(List=graft, DispatchPattern=smaller.SmallerThan)  # -> simplify(ListA), simplify(ListB)

pt = Point(sdivide.Points)
tstat = TreeStatistics(Tree=pt)  # -> Paths, Length, Count
series = Series(Start=0, Step=1, Count=tstat.Length)
graft_3 = GraftTree(Tree=tstat.Paths, IncludeEmptyLists=True, IncludeNullItems=True)
concat = Concatenate(FragmentA=graft_3, FragmentB=series)
tag = TextTag(Location=pt, Text=concat)

clean = CleanTree(RemoveNulls=True, RemoveInvalid=True, RemoveEmpty=invert(False), Tree=dispatch.ListB)
clean_2 = CleanTree(RemoveNulls=True, RemoveInvalid=True, RemoveEmpty=invert(False), Tree=dispatch.ListA)
lng = ListLength(List=clean)
tstat_2 = TreeStatistics(Tree=lng)  # -> Paths, Length, Count
genes = GenePool(
    Decimals=2,
    Maximum=1.5,
    Minimum=-1.5,
    Value=[1.13, -0.98, 0.23, 1.19, -0.94, 0.41, 0.87, -0.58, 0.79, -1.17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])
series_2 = Series(Start=0, Step=1, Count=tstat_2.Count)
graft_4 = GraftTree(Tree=series_2, IncludeEmptyLists=True, IncludeNullItems=True)
graft_5 = GraftTree(Tree=genes, IncludeEmptyLists=True, IncludeNullItems=True)  # -> simplify(Tree)
list = ValueList({"Flat Option": 0, "Random Option": 1, "Optimisation Process": 2}, selected="Random Option")
random = Random(Range="-1.5 to 1.5", Number=lng, Seed=simplify(graft_4))
match = MatchTree(Tree=graft_5, Guide=clean)
filter = StreamFilter(Gate=list, Stream0="0.00", Stream1=random, Stream2=match)
Z = UnitZ(Factor=filter)
move = Move(Geometry=clean, Motion=Z)  # -> simplify(Geometry), Transform
merge = Merge(Data1=clean_2, Data2=move.Geometry)  # -> flatten(Result)
addition = Addition(A="6", B=1)
srfgrid = SurfaceFromPoints(Points=simplify(merge), UCount=addition, Interpolate=False)
mesh_breps = MeshBrepsKaramba3D(
    Brep=srfgrid,
    MeshResolution="0.5",
    EdgeRefinementFactor=0.67,
    PointReduction=False,
    SmoothingStepSize=0,
    SmoothingIterations=5)  # -> Mesh, Info

mesh = Mesh(mesh_breps.Mesh)
matselect = MaterialSelectionKaramba3D(menu=[dropdown(7), dropdown(8)])
cross_section = CrossSectionKaramba3D(FamilyNameOfCrossSection="DefaultCroSec", Material=matselect, Height_cm="6", mode="Shell - Const")
meshtoshell = MeshToShellKaramba3D(Mesh=mesh, CrossSection=cross_section, LimitDistance_m=0.005)  # -> Element, Points, Info

panel = Panel("5")  # "kN/mq"
neg = Negative(Value=panel)
nv = NakedVertices(Mesh=mesh_breps.Mesh)  # -> ClothedIndex, NakedIndex, ClothedPts, NakedPts
Z_2 = UnitZ(Factor=neg)
mesh_2 = Mesh(mesh)
pt_2 = Point(nv.NakedPts)
supp = SupportKaramba3D(PosInd=pt_2, menu=[buttons(on, on, on, off, off, off)])
loads = LoadsKaramba3D(Vector=Vector(0, 0, -1), LCase="0", mode="Gravity")
loads_2 = LoadsKaramba3D(Vector=Z_2, Mesh=mesh_2, LCase="0", mode="MeshLoad -Const.", menu=[buttons(off, on, off), buttons(on, on)])
load = LoadKaramba3D(flatten([loads, loads_2]))
load_2 = LoadKaramba3D(load)
element = ElementKaramba3D(meshtoshell.Element)
support = SupportKaramba3D(supp)
assemble = AssembleModelKaramba3D(Elem=element, Support=support, Load=load_2, LimitDistance_m=0.005)  # -> Model, Info, Mass_kg, CenterOfGravity, LoadCaseNames
analyze = AnalyzeKaramba3D(Model=assemble.Model)  # -> CalculatedModel, MaximumDisplacement_cm, ResultingForceOfGravity_kN, ElasticEnergyChange_kNm
clr = ColorsAlpaca4d(gradIndex=11)  # -> reverse(colors); inputs gradIndex: Int32
#   port colors: A series of colors to be plugged into the "Ladybug_Legend Parameters" component.
# ---------- clr: Python ----------
"""
Preset of gradient colors perfect for Data Visualisation
    Inputs:
        gradIndex: An index refering to one of the following possible gradients:
            0 - Orignal Ladybug
            1 - Nuanced Ladybug
            2 - Multi-colored Ladybug
            3 - Ecotect
            4 - Thermal Comfort Percentage
            5 - Thermal Comfort Colors
            6 - Shade Benefit/Harm
            7 - Shade Harm
            8 - Shade Benefit
            9 - CFD Colors 1
            10 - Radiation Benefit
            11 - Gsa10 Colour
            12 - Gsa9 Colour
    Returns:
        customColors: A series of colors.
"""

ghenv.Component.Name = "Colors (Alpaca4d)"
ghenv.Component.NickName = 'CLR'
ghenv.Component.Message = 'Colors (Alpaca4d)'

import scriptcontext as sc
import Grasshopper.Kernel as gh
import System

gradientLibrary = {
        0: [System.Drawing.Color.FromArgb(75, 107, 169), System.Drawing.Color.FromArgb(115, 147, 202), System.Drawing.Color.FromArgb(170, 200, 247), System.Drawing.Color.FromArgb(193, 213, 208), System.Drawing.Color.FromArgb(245, 239, 103), System.Drawing.Color.FromArgb(252, 230, 74), System.Drawing.Color.FromArgb(239, 156, 21), System.Drawing.Color.FromArgb(234, 123, 0), System.Drawing.Color.FromArgb(234, 74, 0), System.Drawing.Color.FromArgb(234, 38, 0)],
        1: [System.Drawing.Color.FromArgb(49,54,149), System.Drawing.Color.FromArgb(69,117,180), System.Drawing.Color.FromArgb(116,173,209), System.Drawing.Color.FromArgb(171,217,233), System.Drawing.Color.FromArgb(224,243,248), System.Drawing.Color.FromArgb(255,255,191), System.Drawing.Color.FromArgb(254,224,144), System.Drawing.Color.FromArgb(253,174,97), System.Drawing.Color.FromArgb(244,109,67), System.Drawing.Color.FromArgb(215,48,39), System.Drawing.Color.FromArgb(165,0,38)],
        2: [System.Drawing.Color.FromArgb(4,25,145), System.Drawing.Color.FromArgb(7,48,224), System.Drawing.Color.FromArgb(7,88,255), System.Drawing.Color.FromArgb(1,232,255), System.Drawing.Color.FromArgb(97,246,156), System.Drawing.Color.FromArgb(166,249,86), System.Drawing.Color.FromArgb(254,244,1), System.Drawing.Color.FromArgb(255,121,0), System.Drawing.Color.FromArgb(239,39,0), System.Drawing.Color.FromArgb(138,17,0)],
        3: [System.Drawing.Color.FromArgb(0,0,255), System.Drawing.Color.FromArgb(53,0,202), System.Drawing.Color.FromArgb(107,0,148), System.Drawing.Color.FromArgb(160,0,95), System.Drawing.Color.FromArgb(214,0,41), System.Drawing.Color.FromArgb(255,12,0), System.Drawing.Color.FromArgb(255,66,0), System.Drawing.Color.FromArgb(255,119,0), System.Drawing.Color.FromArgb(255,173,0), System.Drawing.Color.FromArgb(255,226,0), System.Drawing.Color.FromArgb(255,255,0)],
        4: [System.Drawing.Color.FromArgb(0,0,0), System.Drawing.Color.FromArgb(110,0,153), System.Drawing.Color.FromArgb(255,0,0), System.Drawing.Color.FromArgb(255,255,102), System.Drawing.Color.FromArgb(255,255,255)],
        5: [System.Drawing.Color.FromArgb(0,136,255), System.Drawing.Color.FromArgb(200,225,255), System.Drawing.Color.FromArgb(255,255,255), System.Drawing.Color.FromArgb(255,230,230), System.Drawing.Color.FromArgb(255,0,0)],
        6: [System.Drawing.Color.FromArgb(5,48,97), System.Drawing.Color.FromArgb(33,102,172), System.Drawing.Color.FromArgb(67,147,195), System.Drawing.Color.FromArgb(146,197,222), System.Drawing.Color.FromArgb(209,229,240), System.Drawing.Color.FromArgb(255,255,255), System.Drawing.Color.FromArgb(253,219,199), System.Drawing.Color.FromArgb(244,165,130), System.Drawing.Color.FromArgb(214,96,77), System.Drawing.Color.FromArgb(178,24,43), System.Drawing.Color.FromArgb(103,0,31)],
        7: [System.Drawing.Color.FromArgb(255,255,255), System.Drawing.Color.FromArgb(253,219,199), System.Drawing.Color.FromArgb(244,165,130), System.Drawing.Color.FromArgb(214,96,77), System.Drawing.Color.FromArgb(178,24,43), System.Drawing.Color.FromArgb(103,0,31)],
        8: [System.Drawing.Color.FromArgb(255,255,255), System.Drawing.Color.FromArgb(209,229,240), System.Drawing.Color.FromArgb(146,197,222), System.Drawing.Color.FromArgb(67,147,195), System.Drawing.Color.FromArgb(33,102,172), System.Drawing.Color.FromArgb(5,48,97)],
        9: [System.Drawing.Color.FromArgb(0,16,120), System.Drawing.Color.FromArgb(38,70,160), System.Drawing.Color.FromArgb(5,180,222), System.Drawing.Color.FromArgb(16,180,109), System.Drawing.Color.FromArgb(59,183,35), System.Drawing.Color.FromArgb(143,209,19), System.Drawing.Color.FromArgb(228,215,29), System.Drawing.Color.FromArgb(246,147,17), System.Drawing.Color.FromArgb(243,74,0), System.Drawing.Color.FromArgb(255,0,0)],
        10: [System.Drawing.Color.FromArgb(0,191,48), System.Drawing.Color.FromArgb(255,238,184), System.Drawing.Color.FromArgb(255,0,0)],
        11: [System.Drawing.Color.FromArgb(204,0,71), System.Drawing.Color.FromArgb(255,182,71), System.Drawing.Color.FromArgb(206,255,115), System.Drawing.Color.FromArgb(26,180, 214),System.Drawing.Color.FromArgb(0,0,207)],
        12: [System.Drawing.Color.FromArgb(255, 51, 51), System.Drawing.Color.FromArgb(255, 170, 51), System.Drawing.Color.FromArgb(255, 255, 51), System.Drawing.Color.FromArgb(170, 255, 125), System.Drawing.Color.FromArgb(51, 255, 231), System.Drawing.Color.FromArgb(51, 170, 255), System.Drawing.Color.FromArgb(51,51, 255)]}
colors = gradientLibrary[gradIndex]
# ---------- end clr ----------
legend = Legend(Colour=clr, Tags=["One Fish", "Two Fish", "Red Fish", "Blue Fish"], LegendType=1)
galapagos = Galapagos(fitness=num, gene=genes)
num = Number(analyze.MaximumDisplacement_cm)
modelview = ModelViewKaramba3D(Model=analyze.CalculatedModel, ResultFactors=1, ResultCase=-1, Colors=clr)  # -> Model, DeformedMesh, DeformedAxes, DeformedModel
shellview = ShellViewKaramba3D(Model=modelview.Model, IndexOfLayer=0)  # -> Model, MeshesOfRenderedShells, LegendColors, LegendTags
wbnaked = WeaverbirdsNakedBoundary(MeshClosedPolylines=shellview.MeshesOfRenderedShells)
preview = CustomPreview(
    Geometry=shellview.MeshesOfRenderedShells,
    Material={diffuse=RGB(221, 160, 221), emission=RGB(66, 48, 66), shine=0.5, specular=RGB(255, 255, 255), transparency=0})
utilization = UtilizationOfElementsKaramba3D(AnalyzedModel=shellview.Model, mode="Shells")  # -> AnalyzedModel, Utilization; disabled
previewlw = CustomPreviewLineweights(Geometry=wbnaked, Shader=ColourSwatch(SwatchColor=RGB(0, 0, 0)), Thickness="3", Absolute=False)
panel_2 = Panel(utilization.Utilization)  # disabled
bnd = Bounds(Numbers=utilization.Utilization)  # disabled

# ---- group: visualisation: Data on screen
result_1 = Data(analyze.MaximumDisplacement_cm)
num_2 = Number(expr("round(x,2)", result_1))
concat_2 = Concatenate(FragmentA="Deflection: ", FragmentB=num_2, FragmentC=" cm", JoinSeparator=" ")
entwine = Entwine(Branch00=concat_2, FlattenInputs=True)  # -> flatten(Result)
left_right_position_pixels = Panel("50")
spacing_pixels = Panel("30")
up_down_position_pixels = Panel("100")
lng_2 = ListLength(List=entwine)
series_3 = Series(Start=up_down_position_pixels, Step=spacing_pixels, Count=lng_2)
pt_3 = ConstructPoint(XCoordinate=left_right_position_pixels, YCoordinate=series_3, ZCoordinate=0)
texttoscreen = RenderTextToScreen(Text=entwine, Location=pt_3, Size=14, Color=RGB(0, 0, 0), Font="Inconsolata", m_scWithvp=False)

# ----
panel_3 = Panel(bnd)  # disabled
